# Dynamo graph panda.dyn (Dynamo 2.0.2.6826)

file_path = Filename("pandasDynamo\helloworld.py")
code_block = CodeBlock { {"one's":[1,11,111,11,1],"two's":[2,22,222,22,2],"three's":[3,33,333,33,3],"four's":[4,44,444,44,4]}; }
runPyFile = DynamoPandas.Pandas.RunPyFile(filePath=file_path, dataDictionary=code_block)  # frozen
code_block_2 = CodeBlock()
# ---------- code_block_2.designscript (1 lines) ----------
{"one's":[1,11,111,1111,11111,111111,11111,1111,111,11,1,1,11,111,1111,11111,111111,11111,1111,111,11,1,1,11,111,1111,11111,111111,11111,1111,111,11,1],"two's":[2,22,222,2222,22222,222222,22222,2222,222,22,2,2,22,222,2222,22222,222222,22222,2222,222,22,2,2,22,222,2222,22222,222222,22222,2222,222,22,2],"three's":[3,33,333,3333,33333,333333,33333,3333,333,33,3,3,33,333,3333,33333,333333,33333,3333,333,33,3,3,33,333,3333,33333,333333,33333,3333,333,33,3]};
# ----------------------------------------
helloWorldTest = DynamoPandas.Test.HelloWorldTest(message=code_block)  # frozen
byDictionary = DynamoPandas.Pandas.DataFrame.ByDictionary(dataDictionary=code_block)
dataFrameStr = DynamoPandas.Pandas.DataFrame.DataFrameStr(dataFrame=byDictionary)
code_block_3 = CodeBlock { ["one's"]; 1; }
byItems = DynamoPandas.FilterDataframe.FilterByItems.ByItems(dataframe=byDictionary, items=code_block_3.out0, axis=code_block_3.out1)
dataFrameStr_2 = DynamoPandas.Pandas.DataFrame.DataFrameStr(dataFrame=byItems)
code_block_4 = CodeBlock {  }
